# Grasshopper definition PillowBox.gh (Grasshopper 1.0.7)

width_scale = Slider(0.8, range=0..1)
genes = GenePool(Decimals=2, Maximum=90, Minimum=-90, Value=[52.848, 10.9, 55.116, 8.72])
divide = Slider(10, range=5..20)
a = Slider(129.38, range=0..360)
z = Slider(1, range=0..10)
point1 = Point(<point referenced from the Rhino model>)
point2 = Point(<point referenced from the Rhino model>)
pt = Point()
rectangle = Rectangle(Plane=PlaneXY(0, 0, 0), XSize=Slider(20, range=10..40), YSize=Slider(12.64, range=10..40), Radius=0)  # -> Rectangle, Length
rad = Radians(Degrees=a)
rad_2 = Radians(Degrees=genes)
c_script = CSharpScript(P=pt, z=z)  # -> out, A; inputs P: list of Point3d, z: Double
# ---------- c_script: C# ----------
List<Point3d> _A = new List<Point3d>();
_A.Add(new Point3d(P[0]));
_A.Add(new Point3d(P[1].X, P[1].Y, P
# ---------- end c_script ----------
cp = ControlPoints(Curve=rectangle.Rectangle)  # -> Points, Weights, Knots
input_curve = CSharpScript(P=cp.Points, N=divide, p1=point1, p2=point2)  # -> out, Points2d, Bezier2d, K_ori; inputs P: list of Point3d, N: Int32, p1: Point3d, p2: Point3d
# ---------- input_curve: C# ----------
List<Point3d> CP2d = new List<Point3d>();
List<Point3d> BP2d = new List<Point3d>();
List<double> K = new List<double>();
Vector3d Axis = new Vector3d(0,1,0);
Point3d p0 = P[0],  p3 = P[1];
double y = P[3].Y / 2;

CP2d.Add(new Point3d(P[0])); CP2d.Add(p1); CP2d.Add(p2); CP2d.Add(new Point3d(P[1]));

for(int n = 0; n < N; n++){
    double t = 1 - (double) n / (double) (N - 1);
    Point3d p = new Point3d(0, 0, 0);
    for(int i = 0; i < 4; i++)p += cmb(3, i) * Math.Pow(1.0 - t, 3 - i) * Math.Pow(t, i) * CP2d[i];
    BP2d.Add(p);
}

for(int i = 1; i < N - 1; i++){
    Vector3d e = new Vector3d(BP2d[i-1] - BP2d[i]); e.Unitize();
    Vector3d e2 = new Vector3d(BP2d[i+1] - BP2d[i]); e.Unitize();
    double k = 2 * Math.PI - Math.Abs(Vector3d.VectorAngle(e, Axis)) - Math.Abs(Vector3d.VectorAngle(e2, Axis));

    K.Add(k);
}

Points2d = CP2d; Bezier2d = BP2d; K_ori = K;
# ---------- input_curve: C# additional code ----------
  double fact(int n){
    if(n <= 1)return 1;
    return n * fact(n - 1);
  }
  double cmb(int n, int k){
    return fact(n) / fact(k);
  }
# ---------- end input_curve ----------
bezier = CSharpScript(X=pt, T_step=Slider(0.01, range=0..1))  # -> Out, A
c_script_2 = CSharpScript(P_ori=input_curve.Points2d, Phi=rad_2, wc=width_scale, N=divide)  # -> out, Points2d, Points3d, Bezier2d, Bezier3d; inputs P_ori: list of Point3d, Phi: list of Double, wc: Double, N: Int32
# ---------- c_script_2: C# ----------
List<Point3d> P3d = new List<Point3d>();
List<Point3d> P2d = new List<Point3d>();
List<Point3d> BP2d = new List<Point3d>();
List<Point3d> BP3d = new List<Point3d>();

Point3d p0 = new Point3d(P_ori[0]), p3 = new Point3d(P_ori[3]);
double l0 = P_ori[0].DistanceTo(P_ori[1]), l1 = P_ori[3].DistanceTo(P_ori[2]);
p3.X = p0.X + wc * p0.DistanceTo(p3);
Vector3d Axis = new Vector3d(0,1,0), Z = new Vector3d(0,0,1), Y = new Vector3d(0,1,0);;
Vector3d e1 = new Vector3d(Axis), e2 = new Vector3d(Axis);
e1.Rotate(Phi[0], Z); e2.Rotate(Phi[2], Z);
e1.Rotate(Phi[1], Y); e2.Rotate(Phi[3], Y);
Point3d p1 = l0 * e1 + p0, p2 = l1 * e2 + p3;
Point3d _p1 = new Point3d(p1), _p2 = new Point3d(p2); _p1.Z = 0; _p2.Z = 0;

P3d.Add(p0); P3d.Add(p1); P3d.Add(p2); P3d.Add(p3);
P2d.Add(p0); P2d.Add(_p1); P2d.Add(_p2); P2d.Add(p3);

for(int n = 0; n < N; n++){
    double t = 1 - (double) n / (double) (N - 1);
    BP3d.Add(bezier(t, P3d)); BP2d.Add(bezier(t, P2d));
}
Points2d = P2d; Points3d = P3d; Bezier2d = BP2d; Bezier3d = BP3d;
# ---------- c_script_2: C# additional code ----------
double fact(int n){
    if(n <= 1)return 1;
    return n * fact(n - 1);
}

double cmb(int n, int k){return fact(n) / fact(k);}

Point3d bezier(double t, List<Point3d> CP){
    Point3d p = new Point3d(0,0,0);
    for(int i = 0; i < 4; i++)p += cmb(3, i) * Math.Pow(1.0 - t, 3 - i) * Math.Pow(t, i) * CP[i];
    return p;
}
# ---------- end c_script_2 ----------
e_iso = CSharpScript(Crv_ori=input_curve.Bezier2d, Bezier3d=c_script_2.Bezier3d)  # -> out, f; inputs Crv_ori: list of Point3d, Bezier3d: list of Point3d
# ---------- e_iso: C# ----------
double _f = 0.0;
for(int i = 0; i < Crv_ori.Count - 1; i++){
  _f += Math.Abs(Crv_ori[i].DistanceTo(Crv_ori[i+1]) - Bezier3d[i].DistanceTo(Bezier3d[i+1]));
}
f = _f;
# ---------- end e_iso ----------
generate_rulings_directions = CSharpScript(Bezier3d=c_script_2.Bezier3d, Bezier2d=c_script_2.Bezier2d, a=rad)  # -> out, K, Beta, Theta, Normals, Rulings3d, Rulings2d, Tau, A; inputs Bezier3d: list of Point3d, Bezier2d: list of Point3d, a: Double
# ---------- generate_rulings_directions: C# ----------
List<double> _K = new List<double>(), _B = new List<double>(), _T = new List<double>(), _Tau = new List<double>(), _A = new List<double>();
List<Vector3d> _Normals = new List<Vector3d>(), _Rulings3d = new List<Vector3d>();
List<Vector3d> _Rulings2d = new List<Vector3d>();
Vector3d Axis = new Vector3d(0,1,0);
Vector3d befN = new Vector3d(), N = new Vector3d();
Vector3d Z = new Vector3d(0,0,-1);
double a2 = 0.0;

for(int i = 1; i < Bezier3d.Count - 1; i++){
    Vector3d e =  new Vector3d(Bezier3d[i-1] - Bezier3d[i]); e.Unitize();
    Vector3d e2 = new Vector3d(Bezier3d[i+1] - Bezier3d[i]); e2.Unitize();
    N = Vector3d.CrossProduct(e, e2); N.Unitize();
    if(i != 1){
        Vector3d SrfN = ProjectionVec(e, N);
        double tau = Math.Acos(Vector3d.Multiply(befN, SrfN));
        if(Vector3d.Multiply(e, Vector3d.CrossProduct(befN, SrfN)) < 0)tau = 2 * Math.PI - tau;
        a = a2 - tau;
        if(a < 0) a += 2 * Math.PI;
        _Tau.Add(tau);
    }
    double b = Vector3d.VectorAngle(e, e2);
    double k = 2 * Math.PI - Math.Abs(Vector3d.VectorAngle(e, Axis)) - Math.Abs(Vector3d.VectorAngle(e2, Axis));

    N.Rotate(a, e);
    double theta = Math.Atan2(Math.Cos(k) - Math.Cos(b), Math.Sin(b)* Math.Cos(a) - Math.Sin(k));
    if(theta < 0) theta += Math.PI;
    Vector3d r3d = new Vector3d(e); r3d.Rotate(theta, N);
    Vector3d r2d = new Vector3d(Bezier2d[i - 1] - Bezier2d[i]); r2d.Unitize(); r2d.Rotate(theta, Z);
    _Rulings2d.Add(r2d); _Rulings3d.Add(r3d);
    double sin_a = Math.Sin(a) * Math.Sin(theta)/Math.Sin(k - theta);
    double cos_a = (Math.Cos(theta) - Math.Cos(k - theta)*Math.Cos(b))/(Math.Sin(k - theta)*Math.Sin(b));
    a2 = Math.Atan(sin_a/cos_a);
    if(a2 < 0) a2 += 2 * Math.PI;
    befN = ProjectionVec(e2, Vector3d.CrossProduct(e, e2));  befN.Unitize();
    _K.Add(k); _B.Add(b); _Normals.Add(N); _A.Add(cos_a); _T.Add(theta);
}

K = _K; Beta = _B; Theta = _T; Rulings3d = _Rulings3d; Rulings2d = _Rulings2d; Normals = _Normals; Tau = _Tau; A = _A;
# ---------- generate_rulings_directions: C# additional code ----------
Vector3d ProjectionVec(Vector3d N, Vector3d v){
    N.Unitize();
    Vector3d V = new Vector3d(v - Vector3d.Multiply(Vector3d.Multiply(v,N), N));
    V.Unitize();
    return V;
}
# ---------- end generate_rulings_directions ----------
e_sim = CSharpScript(K_ori=input_curve.K_ori, K=generate_rulings_directions.K)  # -> out, f; inputs K_ori: list of Double, K: list of Double
# ---------- e_sim: C# ----------
double _f = 0.0;
for(int i = 0; i < K_ori.Count; i++)_f += Math.Abs(K_ori[i] - K[i]);
f = _f;
# ---------- end e_sim ----------
getcrosspoints = CSharpScript(
    Outline=cp.Points,
    Bezier2d=c_script_2.Bezier2d,
    Bezier3d=c_script_2.Bezier3d,
    Rulings2d=generate_rulings_directions.Rulings2d,
    Rulings3d=generate_rulings_directions.Rulings3d)  # -> out, Line2d, Line3d; inputs Outline: list of Point3d, Bezier2d: list of Point3d, Bezier3d: list of Point3d, Rulings2d: list of Vector3d, Rulings3d: list of Vector3d
# ---------- getcrosspoints: C# ----------
double len = 1000;
List<Line> L2d = new List<Line>();
List<Line> L3d = new List<Line>();
for(int i = 0; i < Rulings2d.Count; i++){
    Line la = new Line(Bezier2d[i+1], Rulings2d[i], len);
    for(int j = 0; j < Outline.Count - 1; j++){
        double a, b;
        Line lb = new Line(Outline[j], Outline[j+1]);
        if(Rhino.Geometry.Intersect.Intersection.LineLine(la, lb, out a, out b)){
            if(0 <= b && b <= 1 && 0 <= a && a <= 1){
                Point3d p2d = la.PointAt(a);
                L2d.Add(new Line(Bezier2d[i+1], p2d));
                Point3d p3d = p2d.DistanceTo(Bezier2d[i+1]) * Rulings3d[i] + Bezier3d[i+1];
                L3d.Add(new Line(Bezier3d[i+1], p3d));
            }
        }
    }
}
Line2d = L2d; Line3d = L3d;
# ---------- end getcrosspoints ----------
e_ruling = CSharpScript(Line2d=getcrosspoints.Line2d)  # -> out, f; inputs Line2d: list of Line
# ---------- e_ruling: C# ----------
double _f = 0.0;
double a,b;
for(int i = 0; i < Line2d.Count; i++){
    for(int j = -1; j <= 1; j += 2){
        int i2 = i + j;
        if(i2 < 0 || i2 >= Line2d.Count)continue;
        if(Rhino.Geometry.Intersect.Intersection.LineLine(Line2d[i], Line2d[i2], out a, out b)){
            if(0 <= b && b <= 1 && 0 <= a && a <= 1)_f += 1.0/b;
        }
    }
}
f = _f;
# ---------- end e_ruling ----------
e_plane = CSharpScript(Line3d=getcrosspoints.Line3d)  # -> out, f; inputs Line3d: list of Line
# ---------- e_plane: C# ----------
double _f = 0.0;
foreach(Line l in Line3d){
    _f += Math.Abs(l.To.Z);
}
f = _f;
# ---------- end e_plane ----------
